# Grasshopper definition git_robot.gh (Grasshopper 1.0.7)
# plug-ins: Triceratops, Githopper

# ---- group: Github Integration
username = Panel("l00sed")
email = Panel("danielwtompkins@gmail.com")
button = Button()
toggle = BooleanToggle(True)
execute = ExecuteGitCommand(Command="git commit -m \"updated\" & exit", Execute=Button())
execute_2 = ExecuteGitCommand(Command="git push origin master & exit", Execute=Button())
execute_3 = ExecuteGitCommand(Command="git add -A & exit", Execute=Button())
nickname = RelativePath()
select_branch = SelectBranch(Index=Slider(0, range=0..100))  # -> Branch, Branches
create_git = CreateGitRepository(User_name=username, User_email=email, Initialize=toggle)  # -> Report, Help
path = GitPath(Path=nickname, Create_path=toggle, Set=button)  # -> Report, Help
push = PushToRepository(Branch=select_branch.Branch, Repository="https://github.com/l00sed/grasshopper", Push=button)
panel = Panel(create_git.Report)
panel_2 = Panel(push)
panel_3 = Panel(path.Report)
