# Grasshopper definition palette_git_master.gh (Grasshopper 0.9.76)
# plug-ins: Python Interpreter, Palette

# ---- group: Palette
swatch = ColourSwatch(SwatchColor=RGBA(0, 255, 255, 0))
swatch_2 = ColourSwatch(SwatchColor=RGB(64, 70, 67))
swatch_3 = ColourSwatch(SwatchColor=RGBA(0, 0, 0, 28))
swatch_4 = ColourSwatch(SwatchColor=RGB(68, 255, 156))
swatch_5 = ColourSwatch(SwatchColor=RGB(255, 187, 156))
swatch_6 = ColourSwatch(SwatchColor=RGB(241, 111, 90))
swatch_7 = ColourSwatch(SwatchColor=RGBA(255, 0, 72, 179))
swatch_8 = ColourSwatch(SwatchColor=RGB(255, 0, 72))
swatch_9 = ColourSwatch(SwatchColor=RGB(40, 50, 50))
swatch_10 = ColourSwatch(SwatchColor=RGB(255, 255, 255))
swatch_11 = ColourSwatch(SwatchColor=RGB(255, 55, 72))
number_slider = Slider(15, range=0..100)
# Line
# LineBasicMaterial
# LineDashedMaterial
# LineBasicMaterial
# LineDashedMaterial
# Scene Example
# Annotations
number_slider_2 = Slider(100, range=0..100)
swatch_12 = ColourSwatch(SwatchColor=RGBA(255, 255, 255, 160))
palette = Palette(
    ModeCustomStandard=Toggle(True),
    Component_Normal_Deselected_Fill_Color=swatch_2,
    Component_Normal_Deselected_Edge_Color=swatch_3,
    Component_Normal_Deselected_Text_Color=swatch_12,
    Component_Normal_Selected_Fill_Color=swatch_4,
    Component_Normal_Selected_Edge_Color=swatch_3,
    Component_Normal_Selected_Text_Color=ColourSwatch(SwatchColor=RGB(0, 0, 0)),
    Component_Hidden_Deselected_Fill_Color=swatch_3,
    Component_Hidden_Deselected_Edge_Color=swatch_3,
    Component_Hidden_Deselected_Text_Color=swatch_12,
    Component_Hidden_Selected_Fill_Color=ColourSwatch(SwatchColor=RGBA(68, 255, 156, 137)),
    Component_Hidden_Selected_Edge_Color=swatch_3,
    Component_Hidden_Selected_Text_Color=ColourSwatch(SwatchColor=RGBA(0, 0, 0, 203)),
    Component_Disabled_Deselected_Fill_Color=swatch,
    Component_Disabled_Deselected_Edge_Color=swatch,
    Component_Disabled_Deselected_Text_Color=swatch_2,
    Component_Disabled_Selected_Fill_Color=RGB(110, 150, 115),
    Component_Disabled_Selected_Edge_Color=RGB(40, 70, 40),
    Component_Disabled_Selected_Text_Color=RGB(75, 100, 65),
    Component_Warning_Deselected_Fill_Color=swatch_5,
    Component_Warning_Deselected_Edge_Color=swatch_5,
    Component_Warning_Deselected_Text_Color=RGB(0, 0, 0),
    Component_Warning_Selected_Fill_Color=swatch_6,
    Component_Warning_Selected_Edge_Color=swatch_6,
    Component_Warning_Selected_Text_Color=RGB(0, 0, 0),
    Component_Error_Deselected_Fill_Color=swatch_7,
    Component_Error_Deselected_Edge_Color=swatch_7,
    Component_Error_Deselected_Text_Color=swatch_9,
    Component_Error_Selected_Fill_Color=swatch_8,
    Component_Error_Selected_Edge_Color=swatch_8,
    Component_Error_Selected_Text_Color=swatch_9,
    Component_Label_Deselected_Fill_Color=swatch_9,
    Component_Label_Deselected_Edge_Color=swatch_9,
    Component_Label_Deselected_Text_Color=swatch_10,
    Component_Label_Selected_Fill_Color=swatch_9,
    Component_Label_Selected_Edge_Color=swatch_9,
    Component_Label_Selected_Text_Color=swatch_10,
    Galapagos_Deselected_Fill_Color=swatch_11,
    Galapagos_Deselected_Edge_Color=swatch_3,
    Galapagos_Selected_Fill_Color=swatch_4,
    Galapagos_Selected_Edge_Color=swatch_3,
    Wire_Normal_Color=swatch_12,
    Wire_Empty_Color=swatch_3,
    Wire_Selected_Start_Color=swatch_4,
    Wire_Selected_End_Color=ColourSwatch(SwatchColor=RGB(0, 255, 255)),
    Panel_Default_Color=swatch_10,
    Group_Default_Color=swatch_11,
    Canvas_Background_Color=swatch_9,
    Canvas_Gridline_Color=ColourSwatch(SwatchColor=RGB(50, 60, 60)),
    Canvas_Gridline_Width=number_slider,
    Canvas_Gridline_Height=number_slider,
    Canvas_Edge_Color=swatch_11,
    Canvas_Shadow_Color=swatch_11,
    Canvas_Shadow_Size=number_slider_2,
    MonochromaticOnOff=False,
    Monochromatic_Color=RGB(212, 208, 200))

# ---- group: Git
git_status = PythonScript(Bool=Toggle(True))  # -> out, a
# ---------- git_status: Python ----------
import subprocess
if Bool == True:
    print subprocess.check_output(['wsl', 'git', 'status'], cwd='C:\Users\dwt46\Documents\grasshopper')
# ---------- end git_status ----------
git_add = PythonScript(Button=Button())  # -> out, a
# ---------- git_add: Python ----------
import subprocess
if Button == True:
    print subprocess.check_output(['wsl', 'git', 'add', '-A'], cwd='C:\Users\dwt46\Documents\grasshopper')
# ---------- end git_add ----------
git_commit = PythonScript(Button=Button())  # -> out, a
# ---------- git_commit: Python ----------
import subprocess
if Button == True:
    print subprocess.check_output(['wsl', 'git', 'commit', '-m', 'updated'], cwd='C:\Users\dwt46\Documents\grasshopper')
# ---------- end git_commit ----------
git_push = PythonScript(Button=Button())  # -> out, a
# ---------- git_push: Python ----------
import subprocess
if Button == True:
    print subprocess.check_output(['wsl', 'git', 'push', 'origin', 'rhino5'], cwd='C:\Users\dwt46\Documents\grasshopper')
# ---------- end git_push ----------
panel = Panel(git_status.out)
panel_2 = Panel([git_commit.out, git_add.out])
panel_3 = Panel(git_push.out)

# ----
httpin = HttpInput(Start=Toggle(True), Prefix="http://localhost:8080/grasshopper/")  # -> Keys, Values, ListenerObject
httpout = HttpOutput(HttpListener=httpin.ListenerObject)
